# Grasshopper definition GH_mesh_3d_minimal_surface_green_lava_SETUP.gh (Grasshopper 1.0.7)
# plug-ins: Kangaroo2 Components, Bifocals, Urbano

curve = Curve([<curve referenced from the Rhino model> x6])
split_street_curves = SplitStreetCurves(SplitStreetCurves=flatten(curve), IntersectionTolerance=1e-12)  # -> ProcessedStreetCurves, Metadata
multipipe = MultiPipe(
    Curves=split_street_curves.ProcessedStreetCurves,
    NodeSize=Slider(4, range=0..10),
    EndOffset=1,
    StrutSize=1,
    Segment=0,
    KinkAngle=0.6,
    CubeFit=0,
    Caps=0)
mesh_from_subd = MeshFromSubD(SubD=multipipe, Density=2)
mesh_edges = MeshEdges(Mesh=mesh_from_subd)  # -> NakedEdges, InteriorEdges, NonManifoldEdges
curve_2 = Curve(mesh_edges.NakedEdges)
join_curves = JoinCurves(Curves=curve_2, Preserve=False)
discontinuity = Discontinuity(Curve=join_curves, Level=1)  # -> flatten(Points), Parameters
deconstruct_mesh = DeconstructMesh(Mesh=mesh_from_subd)  # -> Vertices, Faces, Colours, Normals
find_similar_member = FindSimilarMember(Data=discontinuity.Points, Set=deconstruct_mesh.Vertices)  # -> Hit, Index
edgelengths = EdgeLengths(Mesh=mesh_from_subd, LengthFactor=Slider(0.5, range=0..1), Strength=1)
anchor = Anchor(Point=find_similar_member.Hit, Strength=10000)
show = Show(G=mesh_from_subd)
merge = Merge(Data2=anchor, Data4=edgelengths, Data5=show)
zombiesolver = ZombieSolver(GoalObjects=flatten(merge), Threshold=1e-10, Tolerance=0.0001, MaxIterations=50000)  # -> I, V, O
list_item = ListItem(List=zombiesolver.O, Index=0, Wrap=True)
