# Grasshopper definition GH_mesh_3d_frei_otto_03_HOPS.gh (Grasshopper 1.0.7)
# plug-ins: Hops

curve = Curve(<curve referenced from the Rhino model>)
point = Point([<point referenced from the Rhino model> x10])
point_2 = Point([<point referenced from the Rhino model> x11])
hops = Hops(
    UpperAnchorPoints=point_2,
    BoundaryCurve=curve,
    ResolutionTextile=Slider(50, range=0..100),
    FloorAnchorPoints=point,
    CacheResultsInMemory=True,
    CacheSolveResults=True,
    RemoteDefinitionLocation="D:\MASTER IAAC\BIMSC21\CLOUD-BASED DATA MANAGMENT\WEEK 01\HOPS\FREI OTTO\GH_mesh_3d_frei_otto_03_SETUP.gh",
    RemoteSolveVersion=(0, 1, 0),
    ShowInput_Enabled=False,
    ShowInput_Path=False,
    SynchronousSolve=True)
