# Grasshopper definition GH_mesh_3d_heightmapper HOPS.gh (Grasshopper 1.0.7)
# plug-ins: Hops

file_path = FilePath("C:\Users\JACINTO MOROS\Downloads\images.jpg")
hops = Hops(
    FilePathToImage=file_path,
    ResolutionImage=Slider(1, range=0..100),
    MaximumHeight=Slider(41, range=0..200),
    CacheResultsInMemory=True,
    CacheSolveResults=True,
    RemoteDefinitionLocation="D:\MASTER IAAC\BIMSC21\CLOUD-BASED DATA MANAGMENT\WEEK 01\HOPS\Heightmapper\GH_mesh_3d_heightmapper SETUP.gh",
    RemoteSolveVersion=(0, 1, 0),
    ShowInput_Enabled=False,
    ShowInput_Path=False,
    SynchronousSolve=True)
