# Grasshopper definition GH_mesh_3d_frei_otto_03_HOPS_jacintomoros.gh (Grasshopper 1.0.7)
# plug-ins: Hops

point = Point([<point referenced from the Rhino model> x16])
curve = Curve(<curve referenced from the Rhino model>)
point_2 = Point([<point referenced from the Rhino model> x17])
hops = Hops(
    UpperAnchorPoints=point_2,
    FloorAnchorPoints=point,
    BoundaryCurve=curve,
    ResolutionTextile=Slider(50, range=0..100),
    CacheResultsInMemory=True,
    CacheSolveResults=True,
    RemoteDefinitionLocation="D:\MASTER IAAC\BIMSC21\CLOUD-BASED DATA MANAGMENT[CRHINO.COMPUTE]\git\bimsc21-datamgmt-by-jacintomoros\bimsc21-datamgmt assignments\Week 01\FREI OTTO\GH_mesh_3d_frei_otto_03_SETUP_jacintomoros.gh",
    RemoteSolveVersion=(0, 1, 0),
    ShowInput_Enabled=False,
    ShowInput_Path=False,
    SynchronousSolve=True)
