# Grasshopper definition GH_mesh_3d_frei_otto_03_SETUP_jacintomoros.gh (Grasshopper 1.0.7)
# plug-ins: Kangaroo2 Components

curve = Curve(<curve referenced from the Rhino model>)
resolution_textile = GetInteger(Slider(100, range=0..100), AtLeast=1, AtMost=2147483647, Maximum=100, Minimum=0)
boundary_curve = GetGeometry(curve, AtLeast=1, AtMost=2147483647, Filter=1074004029)
multiplication = Multiplication(A=resolution_textile, B="100")
quad_remesh_settings = QuadRemeshSettings(TargetCount=multiplication, AdaptiveSize=0, AdaptiveCount=False, HardEdges=False, SeamEdges=0, Symmetry=0, GuideCurves=0)
boundary_surfaces = BoundarySurfaces(Edges=boundary_curve)
point = Point([<point referenced from the Rhino model> x15])
floor_anchor_points = GetGeometry(point, AtLeast=1, AtMost=2147483647, Filter=1074004028)
quad_remesh = QuadRemesh(Mesh=boundary_surfaces, Settings=quad_remesh_settings)
point_2 = Point([<point referenced from the Rhino model> x17])
upper_anchor_points = GetGeometry(point_2, AtLeast=1, AtMost=2147483647, Filter=1074004028)
nakedvertices = NakedVertices(Mesh=quad_remesh)  # -> ClothedIndex, NakedIndex, ClothedPts, NakedPts
deconstruct_mesh = DeconstructMesh(Mesh=quad_remesh)  # -> Vertices, Faces, Colours, Normals
deconstruct = Deconstruct(Point=upper_anchor_points)  # -> XComponent, YComponent, ZComponent
closest_point = ClosestPoint(Point=upper_anchor_points, Cloud=deconstruct_mesh.Vertices)  # -> ClosestPoint, CPIndex, Distance
unit_z = UnitZ(Factor=deconstruct.ZComponent)
find_similar_member = FindSimilarMember(Data=flatten(floor_anchor_points), Set=nakedvertices.NakedPts)  # -> Hit, Index
edgelengths = EdgeLengths(Mesh=quad_remesh, LengthFactor=Slider(0.5, range=0..1), Strength=1)
show = Show(G=quad_remesh)
move = Move(Geometry=closest_point.ClosestPoint, Motion=unit_z)  # -> Geometry, Transform
anchor = Anchor(Point=find_similar_member.Hit, Strength=10000)
anchor_2 = Anchor(Point=closest_point.ClosestPoint, Target=move.Geometry, Strength=10000)
merge = Merge(Data1=anchor_2, Data2=anchor, Data3=edgelengths, Data4=show)
zombiesolver = ZombieSolver(GoalObjects=flatten(merge), Threshold=1e-10, Tolerance=0.0001, MaxIterations=50000)  # -> I, V, O
list_item = ListItem(List=zombiesolver.O, Index=0, Wrap=True)
mesh = Mesh(list_item)
context_bake = ContextBake(Geometry=mesh)
