# Grasshopper definition assignment01_mesh_3d_heightmapper HOPSjacintomoros.gh (Grasshopper 1.0.7)
# plug-ins: Hops

file_path = FilePath("D:\MASTER IAAC\BIMSC21\CLOUD-BASED DATA MANAGMENT[CRHINO.COMPUTE]\git\bimsc21-datamgmt-by-jacintomoros\bimsc21-datamgmt assignments\Week 01\Heightmapper\Example Images\heightmapper-1613989004696.png")
hops = Hops(
    MaximumHeight=Slider(41, range=0..200),
    FilePathToImage=file_path,
    ResolutionImage=Slider(1, range=0..100),
    CacheResultsInMemory=True,
    CacheSolveResults=True,
    RemoteDefinitionLocation="D:\MASTER IAAC\BIMSC21\CLOUD-BASED DATA MANAGMENT[CRHINO.COMPUTE]\git\bimsc21-datamgmt-by-jacintomoros\bimsc21-datamgmt assignments\Week 01\Heightmapper\assignment01_mesh_3d_heightmapper SETUP_jacintomoros.gh",
    RemoteSolveVersion=(0, 1, 0),
    ShowInput_Enabled=False,
    ShowInput_Path=False,
    SynchronousSolve=True)
