# Grasshopper definition assignment01_mesh_3d_heightmapper SETUP_jacintomoros.gh (Grasshopper 1.0.7)

# ----
# Extract the BnW image frome this web:
# 
# https://tangrams.github.io/heightmapper/
file_path = FilePath("D:\MASTER IAAC\BIMSC21\CLOUD-BASED DATA MANAGMENT[CRHINO.COMPUTE]\git\bimsc21-datamgmt-by-jacintomoros\bimsc21-datamgmt assignments\Week 01\Heightmapper\Example Images\heightmapper-1641908612878.png")
file_path_to_image = GetString(
    file_path,
    AtLeast=1,
    AtMost=2147483647,
    Prompt="Extract the BnW image frome this web: https://tangrams.github.io/heightmapper/")

resolucion_de_la_imagen = Slider(14, range=1..100)
m = Slider(100, range=0..100)
# https://github.com/jacintomoros/
# 
# More examples:
# 
# https://github.com/jacintomoros/bimsc21-datamgmt-by-jacintomoros/blob/main/bimsc21-datamgmt%20assignments/Week%2001/FREI%20OTTO/GH_mesh_3d_frei_otto_03_SETUP.gh?raw=true
# 
# https://github.com/jacintomoros/bimsc21-datamgmt-by-jacintomoros/blob/main/bimsc21-datamgmt%20assignments/Week%2001/ANISH%20KAPOOR/GH_mesh_3d_minimal_surface_green_lava_SETUP.gh?raw=true
boolean_toggle = BooleanToggle(True)
resolution_image = GetInteger(
    resolucion_de_la_imagen,
    AtLeast=1,
    AtMost=2147483647,
    Maximum=100,
    Minimum=-2147483648,
    Prompt="High number = Less resolution; Low number = High resolution; ")
heightmapper_map = GetString(boolean_toggle, AtLeast=1, AtMost=2147483647, Prompt="Set Boolean to True to open the heightmapper map page")
maximum_height = GetNumber(
    m,
    AtLeast=1,
    AtMost=2147483647,
    Maximum=1.797693135e+308,
    Minimum=-1.797693135e+308,
    Prompt="Decide the highest point of your terrain")
import_image = ImportImage(File=file_path_to_image)
# Set Boolean to True to open the heightmapper map page
ghpython_script = GhPythonScript(download=heightmapper_map)  # -> Output
# ---------- ghpython_script: Python ----------
__author__ = "JACINTO MOROS"
__version__ = "2022.01.19"

import webbrowser as wb
import os

if _download:
   url = 'https://tangrams.github.io/heightmapper/'
   chrome_path="C:\\Program Files (x86)\\Google\\Chrome\\Application\\chrome.exe"
   if os.path.isfile(chrome_path) == True:
       wb.register('chrome', None,wb.BackgroundBrowser(chrome_path),1)
       wb.get('chrome').open(url,2,True)
   else:
       print "Chrome browser not found on your machine. Therefore, the default browser is used."
       wb.open(url,2,True)
   print 'Happy downloading!'
else:
   print 'Set download to true...'
# ---------- end ghpython_script ----------
bounding_box = BoundingBox(Content=import_image, Plane=PlaneXY(0, 0, 0))  # -> Box, Box_2
dimensions = Dimensions(Surface=bounding_box.Box)  # -> UDimension, VDimension
division = Division(A=dimensions.UDimension, B=resolution_image)
division_2 = Division(A=dimensions.VDimension, B=resolution_image)
import_image_2 = ImportImage(File=file_path_to_image, XSamples=division, YSamples=division_2)
deconstruct_mesh = DeconstructMesh(Mesh=import_image_2)  # -> Vertices, Faces, Colours, Normals
split_ahsl = SplitAHSL(Colour=deconstruct_mesh.Colours)  # -> Alpha, Hue, Saturation, Luminance
construct_domain = ConstructDomain(DomainStart=0, DomainEnd=maximum_height)
deconstruct = Deconstruct(Point=deconstruct_mesh.Vertices)  # -> XComponent, YComponent, ZComponent
remap_numbers = RemapNumbers(Value=split_ahsl.Luminance, Source=Domain(0, 1), Target=construct_domain)  # -> Mapped, Clipped
construct_point = ConstructPoint(XCoordinate=deconstruct.XComponent, YCoordinate=deconstruct.YComponent, ZCoordinate=remap_numbers.Mapped)
construct_mesh = ConstructMesh(Vertices=construct_point, Faces=deconstruct_mesh.Faces, Colours=deconstruct_mesh.Colours)
mesh = Mesh(construct_mesh)
context_bake = ContextBake(Geometry=mesh)
